# Dynamo graph Dynword_V1.dyn (Dynamo 2.6.1.8786)
# packages: Clockwork for Dynamo 1.x 1.0.2, archi-lab.net 2021.25.2621

# group: POPUPS
# note: USE:
# Pop ups
# note: ________________________________________________________

# group: SCRIPT DESIGN
# note: ________________________________________________________
# note: USE:
# FOR THE BACK-END FUNCTIONALITY

# group: FROM DYNAMO
# note: ________________________________________________________
# note: USE:
# Export TO Revit (geometry and parameters etc.)

# group: TO DYNAMO
# note: ________________________________________________________
# note: USE:
# Incoming references (File paths, geometry ... )

# group: User Input
# note: ________________________________________________________
# note: USE:
# User input (for eg. sliders, numbers, ....)

# group: MONITOR
# note: USE:
# Stuff you probably want to check
# note: ________________________________________________________

# group: Packages used
# note: Clockwork v.1.0.2
# Rhythm v.2021.6.1
# archilab v.2021.25.2621
# note: ________________________________________________________

# group: TODO
# note: Final letter doesn't 'print' if you win
# Dunno, make forms sexier?
# Add some better graphics?
# note: ________________________________________________________

# group: Instructions for Dynword
# note: How to play
# 1 - Use a TOTALLY BLANK Revit file.
# 2 - Open in Dynamo player.
# 3 - Click run + The game sets
# 4 - Click run + enter a 5 letter word.
# 5 - Repeat step 3 until game over
# 6 - Click run + the reset button
# 7 - Go to step 3
# note: ________________________________________________________
# note: Points to note
# Current language is English. If you want another language you need to find a URL with your language list + amend the Python clean up node accordingly.
# See 'word - imported' group.

# group: NOTES
# note: Project Name = first go (NOT set as Dynword) / not first go (set as Dynword)
# Project Status = word to guess
# Project Number = which go is it?

# group: Revit project name
code_block = CodeBlock { "Project Information"; }
byName = Category.ByName(name=code_block)
all_elements_of_category = ElementsOfCategory(Category=byName)
code_block_2 = CodeBlock { "Project Name"; }
getParameterValueByName = Element.GetParameterValueByName(element=all_elements_of_category, parameterName=code_block_2, lacing=Longest)

# note: Gate to swap between first and other
code_block_3 = CodeBlock(ProjectName=getParameterValueByName) { ProjectName != "Dynword" ? 1 : "Dynword"; }
# note: Gate  -
# if "Dynword" first go
# else other goes
code_block_4 = CodeBlock(OneorDynword=code_block_3) { OneorDynword; }

# group: Words import
n15920 = StringInput("https://raw.githubusercontent.com/dwyl/english-words/master/words_alpha.txt")  # "15920"
web_request = WebRequest(url=n15920)
# note: Websites with words
n1500 = StringInput("https://www.mit.edu/~ecprice/wordlist.10000")  # "< 1500"

# note: All 15920 possible words
python_script = Python(IN[0]=web_request)
# ---------- python_script.python (15 lines) ----------
# Load the Python Standard and DesignScript Libraries
import sys
import clr
clr.AddReference('ProtoGeometry')
from Autodesk.DesignScript.Geometry import *
import random

words = IN[0].split()
GameWords = [] 

for i in words:
	if len(i) == 5:
		GameWords.append(i.upper())
		
OUT = GameWords
# ----------------------------------------
code_block_5 = CodeBlock(AllWords=python_script) { AllWords; }
code_block_6 = CodeBlock(AllWords=code_block_5) { AllWords; }
passthrough = Custom[Passthrough](passThrough=code_block_4, waitFor=code_block_6)  # package Clockwork for Dynamo 1.x; Forces a sequential order of execution. The node wired into the output of the Passthrough node will be executed *after* the node wired into the waitFor input (e.g. important for some Revit operations). The value of the passThrough input will be passed on to the node wired into the output port of the Passthrough node.

# group: Get current marks
code_block_7 = CodeBlock { "FilledRegion"; }
code_block_8 = CodeBlock(ElementName=code_block_7)
# ---------- code_block_8.designscript (3 lines) ----------
DSCore.Types
.FindTypeByNameInAssembly
(ElementName,"RevitAPI");
# ----------------------------------------
all_elements_of_type = ElementsOfType(element_type=code_block_8)
code_block_9 = CodeBlock { "Mark"; }
getParameterValueByName_2 = Element.GetParameterValueByName(element=all_elements_of_type, parameterName=code_block_9, lacing=Longest)
uniqueItems = List.UniqueItems(list=getParameterValueByName_2)

# group: Popup 2
# note: IN
# [0 Run me
# [1] Previous guesses
# [2] All possible words
# note: OUT
# RESET - for resetting
# A letter when playing for a game
python_script_2 = Python(IN[0]=passthrough, IN[1]=uniqueItems, IN[2]=code_block_6)
# ---------- python_script_2.python (106 lines) ----------
import clr
clr.AddReference("System.Windows.Forms")
clr.AddReference("System.Drawing")
import System
from System.Windows.Forms import *
from System.Drawing import *

Runme = IN[0]
Previous_guesses = IN[1]
AllWords = IN[2]

class CreateWindow(Form):
	def __init__(self):
			self.Name = "Create Window"
			self.Text = "©Dynword 2023!"
			self.Size = Size(340, 230)
			self.CenterToScreen()
			self.BackColor = Color.CornflowerBlue
			self.value = None
			        
			label = Label(Text = "Guess a five letter word - (no moose)")
			label.Parent = self
			label.Location = Point(25, 10)
			label.Height = 30
			label.Width = 300
			label.Font = Font("Arial", 12)
			label.ForeColor = Color.Ivory
			
			self.textbox = TextBox()
			self.textbox.Parent = self
			self.textbox.Text = "moose"
			self.textbox.Location = Point(90, 45)
			self.textbox.Size = Size(140, 40)
			self.textbox.Font = Font("Arial", 20)
			self.textbox.Multiline = True
			self.textbox.CharacterCasing = CharacterCasing.Upper
			
			label = Label(Text = "This box stays open until you enter an unguessed, five letter word that is contained in the wordlist.\nReturn or Enter clears the box")
			label.Parent = self
			label.Location = Point(25, 95)
			label.Height = 45
			label.Width = 280
			label.TextAlign = ContentAlignment.MiddleCenter
			label.Font = Font("Arial", 9)
			label.ForeColor = Color.Ivory
			
			self.button1 = Button()
			self.button1.Parent = self
			self.button1.Text = "GUESS WORD"
			self.button1.Font = Font("Arial", 10)
			self.button1.Location = Point(185, 155)
			self.button1.Width = 110
			self.button1.Height = 30
			self.button1.Click += self.ButtonClicked
			self.button1.BackColor = Color.DarkSlateBlue
			self.button1.ForeColor = Color.White
			
			self.button2 = Button()
			self.button2.Parent = self
			self.button2.Text = "NEW GAME"
			self.button2.Font = Font("Arial", 10)
			self.button2.Location = Point(30, 155)
			self.button2.Width = 110
			self.button2.Height = 30
			self.button2.Click += self.ButtonClicked
			self.button2.BackColor = Color.Red
			self.button2.ForeColor = Color.White
				
			# Create Bottom Line
			self.bottom_line = Label()
			self.bottom_line.Parent = self
			self.bottom_line.Location = Point(0, 145)
			self.bottom_line.Size = Size(380, 3)
			self.bottom_line.BorderStyle = BorderStyle.FixedSingle
			self.bottom_line.ForeColor = Color.Black
			
			# Make the form always on top
			self.TopMost = True

	def ButtonClicked(self, sender, args):
		if sender == self.button2: #NEW GAME
			self.value = "RESET"
			self.Close()
		if sender == self.button1: #GUESS WORD
			self.value = self.textbox.Text
			self.Close()
	
# Call the form
if Runme[0] == "Dynword":
	while True:
	    form = CreateWindow()
	    Application.Run(form)
	    if form.value == "RESET":
	    	OUT = form.value
	        break
	    if len(form.value) != 5: 
	        continue
	    elif not form.value.isalpha():
	    	continue
	    elif form.value in Previous_guesses:
	        continue
	    elif form.value not in AllWords:
	        continue
	    else:
	        OUT = form.value
	        break
# ----------------------------------------

# group: The Revit active view
current = Document.Current()
activeView = Document.ActiveView(document=current)

code_block_10 = CodeBlock(ActiveView=activeView) { ActiveView; }
code_block_11 = CodeBlock(Guess=python_script_2, ActiveView=code_block_10) { Guess == "RESET"? "" : ActiveView; }

# group: 5 * 6 Grid of squares
code_block_12 = CodeBlock { Point.ByCoordinates((0..#5..550)<1>, (0..#6..550)<2>); }
reverse = List.Reverse(list=code_block_12@L2)
byOrigin = CoordinateSystem.ByOrigin(origin=reverse)
code_block_13 = CodeBlock { 500; }
byWidthLength = Rectangle.ByWidthLength(cs=byOrigin, width=code_block_13, length=code_block_13)
explode = Geometry.Explode(geometry=byWidthLength)

code_block_14 = CodeBlock(ProjectInfo=all_elements_of_category) { ProjectInfo; }

# group: FIRST
# note: OUT = random 5 letter word
python_script_3 = Python(IN[0]=code_block_3, IN[1]=web_request)
# ---------- python_script_3.python (22 lines) ----------
# Load the Python Standard and DesignScript Libraries
import sys
import clr
clr.AddReference('ProtoGeometry')
from Autodesk.DesignScript.Geometry import *
import random

	
if IN[0][0] == 1:

	words = IN[1].split()
	
	
	GameWords = [] 
	
	for i in words:
	    if len(i) == 5:
	        GameWords.append(i)
	        
	GameWord = random.choice(GameWords)
	
	OUT = GameWord.upper()
# ----------------------------------------

# group: FIRST -Project Status + Project Number
code_block_15 = CodeBlock { ["Project Status", "Project Number"]; }
code_block_16 = CodeBlock(NEW=code_block_3, name=code_block_15) { NEW == 1 ? [name] : ""; }
code_block_17 = CodeBlock(status=python_script_3) { [status, "0"]; }
setParameterByName = Element.SetParameterByName(element=code_block_14, parameterName=code_block_16@L1, value=code_block_17@L1)

# group: Project Status and Number from Revit
code_block_18 = CodeBlock { ["Project Status", "Project Number"]; }
passthrough_2 = Custom[Passthrough](passThrough=code_block_18, waitFor=setParameterByName)
getParameterValueByName_3 = Element.GetParameterValueByName(element=code_block_14@L1, parameterName=passthrough_2)

code_block_19 = CodeBlock(i=getParameterValueByName_3) { i[0][1]; }
# note: 0 - do nothing
# 1 - firstline
# 2 - second line
# 3
# 4
# 5
# 6
# END
toNumber = String.ToNumber(str=code_block_19)
code_block_20 = CodeBlock(GO=toNumber) { GO == 0 ? "" : GO -1; }
getItemAtIndex = List.GetItemAtIndex(list=explode@L3, index=code_block_20)

# group: To Revit - filled regions
# note: Filled region type
python_script_4 = Python()  # unwired: IN[0]
# ---------- python_script_4.python (18 lines) ----------
import clr
clr.AddReference("RevitAPI")
from Autodesk.Revit.DB import *
clr.AddReference("RevitServices")
import RevitServices
from RevitServices.Persistence import DocumentManager

doc = DocumentManager.Instance.CurrentDBDocument
type_name = []

filled_region_types = FilteredElementCollector(doc).OfClass(FilledRegionType).ToElements()

for filled_region_type in filled_region_types:
    type_name_param = filled_region_type.get_Parameter(BuiltInParameter.SYMBOL_NAME_PARAM)
    type_name.append(type_name_param.AsString())
    OUT = filled_region_type

#OUT = (type_name)
# ----------------------------------------
# note: Word boxes filled region in Revit
byCurves = FilledRegion.ByCurves(view=code_block_11, boundary=getItemAtIndex, regionType=python_script_4)

code_block_21 = CodeBlock(Guess=python_script_2) { Guess; }
WORD = CodeBlock(i=getParameterValueByName_3) { i[0][0]; }
code_block_22 = CodeBlock(word=WORD) { word; }

# group: Current guess
green = Custom[Color.Green]()  # package Clockwork for Dynamo 1.x; Returns the colour green.
yellow = Custom[Color.Yellow]()  # package Clockwork for Dynamo 1.x; Returns the colour yellow.
grey = Custom[Color.Grey]()  # package Clockwork for Dynamo 1.x; Returns the colour grey.
python_script_5 = Python(IN[0]=code_block_21, IN[1]=code_block_22, IN[2]=green, IN[3]=yellow, IN[4]=grey)
# ---------- python_script_5.python (42 lines) ----------
Guess = IN[0]
Word = IN[1]
green = IN[2]
yellow = IN[3]
gray = IN[4]
numbers4colours = []
used_letters = ""
letter_counts = {}
output = []

if Guess == "RESET":
	OUT = ""
else:
	# Count the number of occurrences of each letter in Word
	for letter in Word:
	    if letter not in letter_counts:
	        letter_counts[letter] = 1
	    else:
	        letter_counts[letter] += 1
	
	# Compare Guess with Word
	for index, letter in enumerate(Guess):
	    if letter == Word[index]:
	        numbers4colours.append(2)
	        letter_counts[letter] -= 1
	    else:
	        numbers4colours.append(0)
	        
	for index, letter in enumerate(Guess):
	    if numbers4colours[index] == 0 and letter in letter_counts and letter_counts[letter] > 0:
	        numbers4colours[index] = 1
	        letter_counts[letter] -= 1
	
	for num in numbers4colours:
	    if num == 2:
	        output.append(green)
	    elif num == 1: 
	        output.append(yellow)
	    else:
	        output.append(gray)
	
	OUT = output , numbers4colours
# ----------------------------------------
# note: Compare guess with word.
# Green - correct letter correct place
# Yellow -  correct letter wrong place
# Gray - letter not in word
code_block_23 = CodeBlock(i=python_script_5) { i[0]; }
overrideColorInView = Element.OverrideColorInView(element=byCurves, color=code_block_23)

code_block_24 = CodeBlock(ProjectInfo=code_block_14) { ProjectInfo; }
code_block_25 = CodeBlock(runme=code_block_4) { runme[0] == 1? true: false; }

# group: FIRST Popup
# note: OUT = Dynword when button clicked
python_script_6 = Python(IN[0]=code_block_25)
# ---------- python_script_6.python (85 lines) ----------
import clr
clr.AddReference("System.Windows.Forms")
clr.AddReference("System.Drawing")
import System
from System.Windows.Forms import *
from System.Drawing import *
from System.Net import *
from System.IO import MemoryStream

runme = IN[0]

class CreateWindow(Form):
	def __init__(self):
			self.Name = "Create Window"
			self.Text = "Dynword 2023!©"
			self.Size = Size(360, 250)
			self.CenterToScreen()
			        
			label = Label(Text = "Welcome to")
			label.Parent = self
			label.Location = Point(20, 20)
			label.AutoSize = False
			label.Height = 25
			label.Width = 200
			label.ForeColor = Color.Red
			label.Font = Font(label.Font.Name, 16) # set font size to 16
						
			picBox = PictureBox()
			picBox.SizeMode = PictureBoxSizeMode.AutoSize
			picBox.Location = System.Drawing.Point(40, 60)
			
			# Download the image from a URL
			imagePath = r"https://github.com/MoosiestMoose/Dynword/blob/af908ba6535ee30ecd0778c6a1d1f012398552ed/DynwordSMALL.jpg?raw=true"
			client = WebClient()
			data = client.DownloadData(imagePath)
			
			# Create a memory stream from the downloaded data
			memoryStream = MemoryStream(data)
			
			# Set the image as the picture box's image
			image = Image.FromStream(memoryStream)
			picBox.Image = image
			
			# Add the picture box to the form
			self.Controls.Add(picBox)	

			label = Label(Text = "for Revit")
			label.Parent = self
			label.Location = Point(220, 110)
			label.AutoSize = False
			label.Height = 30
			label.Width = 150
			label.ForeColor = Color.Red
			label.Font = Font(label.Font.Name, 16) # set font size to 16
								
			button = Button()
			button.Parent = self
			button.Text = "Click me! Click me! Click me! Go on, Click me!"
			button.Location = Point(40, 170)
			button.Width = 255
			button.Click += self.ButtonClicked
			button.BackColor = Color.Green
			button.ForeColor = Color.White     
			
			# Create Bottom Line
			self.bottom_line = Label()
			self.bottom_line.Parent = self
			self.bottom_line.Location = Point(0, 150)
			self.bottom_line.Size = Size(380, 3)
			self.bottom_line.BorderStyle = BorderStyle.FixedSingle
			self.bottom_line.ForeColor = Color.Black
			
			# Make the form always on top
			self.TopMost = True

	def ButtonClicked(self, sender, args):
		if sender.Click:
			#self.value = "Dynword"
			self.Close()

# Call the form
if runme :
	form = CreateWindow()
	Application.Run(form)
	OUT = "Dynword"
# ----------------------------------------

# group: Set project name to, "Dynword"
code_block_26 = CodeBlock { "Project Name"; }
setParameterByName_2 = Element.SetParameterByName(element=code_block_24, parameterName=code_block_26, value=python_script_6)

# note: Active view first go gate.
code_block_27 = CodeBlock(NEW=code_block_3, view=activeView) { NEW == 1 ? view : ""; }

# group: FIRST
# note: Square outlines in Revit
byCurve = DetailCurve.ByCurve(view=code_block_27, curve=explode@L1)

code_block_28 = CodeBlock(ProjectInfo=code_block_24) { ProjectInfo; }
code_block_29 = CodeBlock(reset=python_script_2) { reset; }

# group: Set project number
toNumber_2 = String.ToNumber(str=code_block_19)
code_block_30 = CodeBlock(A=toNumber_2) { A + 1; }
string_from_object = FromObject(obj=code_block_30)
code_block_31 = CodeBlock(input=code_block_29, go=string_from_object) { "Project Number"; input == "RESET"? "0" : go; }
setParameterByName_3 = Element.SetParameterByName(element=code_block_28, parameterName=code_block_31.out0, value=code_block_31.out1)

code_block_32 = CodeBlock(ActiveView=code_block_10) { ActiveView; }

# group: Placement points for words
getItemAtIndex_2 = List.GetItemAtIndex(list=reverse@L2, index=code_block_20)
X = Point.X(point=getItemAtIndex_2)
Y = Point.Y(point=getItemAtIndex_2)
code_block_33 = CodeBlock(Y=Y) { Y + 200; }
byCoordinates = Point.ByCoordinates(x=X, y=code_block_33)

code_block_34 = CodeBlock(Guess=python_script_2) { Guess; }
# note: Guess as a list
python_script_7 = Python(IN[0]=code_block_34)
# ---------- python_script_7.python (7 lines) ----------
OUT = []

if IN[0] == "RESET":
	OUT = ""
else: 
	for i in IN[0]:
		OUT.append(i)
# ----------------------------------------

# group: Text in Revit
code_block_35 = CodeBlock { "Center"; }
byLocation = TextNote.ByLocation(view=code_block_32, location=byCoordinates, text=python_script_7, alignment=code_block_35)
type = archilab.Revit.Elements.Elements.Type(element=byLocation)
code_block_36 = CodeBlock { ["Text Font" ,"Background", "Text Size"]; }
code_block_37 = CodeBlock { ["Arial", 1, 2.5]; }
setParameterByName_4 = Element.SetParameterByName(element=type, parameterName=code_block_36, value=code_block_37)

# group: FINAL Popup Win
code_block_38 = CodeBlock(i=python_script_5) { i[1]; }
sum = Math.Sum(values=code_block_38)
code_block_39 = CodeBlock { true; false; }
code_block_40 = CodeBlock(word=code_block_22, sum=sum, win=code_block_39.out0, continues=code_block_39.out1) { word; sum == 10? win : continues; }
python_script_8 = Python(IN[0]=code_block_40.word, IN[1]=code_block_40.out1)
# ---------- python_script_8.python (67 lines) ----------
import clr
clr.AddReference("System.Windows.Forms")
clr.AddReference("System.Drawing")
import System
from System.Windows.Forms import *
from System.Drawing import *
from System.Net import *
from System.IO import MemoryStream

word = IN[0]
RunMe = IN[1]

class CreateWindow(Form):
	def __init__(self):
			self.Name = "Create Window"
			self.Text = "Dynword 2023!©"
			self.Size = Size(360, 250)
			self.CenterToScreen()
			        
			label = Label(Text = "WINNER!\nThe word was:")
			label.Parent = self
			label.Location = Point(10, 20)
			label.AutoSize = False
			label.Height = 50
			label.Width = 340
			label.ForeColor = Color.DarkSlateGray
			label.Font = Font(label.Font.Name, 16) 
			label.TextAlign = ContentAlignment.MiddleCenter
						
			picBox = PictureBox()
			picBox.SizeMode = PictureBoxSizeMode.AutoSize
			picBox.Location = System.Drawing.Point(40, 60)

			label = Label(Text =  word + "  ッ")
			label.Parent = self
			label.Location = Point(10, 80)
			label.AutoSize = False
			label.Height = 50
			label.Width = 340
			label.ForeColor = Color.Red
			label.Font = Font(label.Font.Name, 18) 
			label.TextAlign = ContentAlignment.MiddleCenter
								
			button = Button()
			button.Parent = self
			button.Text = "Close window, click run + 'New Game' on the next pop up"
			button.Font = Font(button.Font.Name, 10)
			button.Location = Point(45, 150)
			button.Width = 255
			button.Height = 50
			button.Click += self.ButtonClicked
			button.BackColor = Color.DarkSlateGray
			button.ForeColor = Color.White     

			# Make the form always on top
			self.TopMost = True

	def ButtonClicked(self, sender, args):
		if sender.Click:
			self.value = "RESET"
			self.Close()

# Call the form
if RunMe:
	form = CreateWindow()
	Application.Run(form)
	OUT = form.value
# ----------------------------------------

code_block_41 = CodeBlock(NewFilledRegions=byCurves) { NewFilledRegions; }

# group: Set mark to guess
code_block_42 = CodeBlock(Guess=code_block_21) { Guess == "RESET"? "" : "Mark"; }
passthrough_3 = Custom[Passthrough](passThrough=code_block_42, waitFor=uniqueItems)
setParameterByName_5 = Element.SetParameterByName(element=code_block_41, parameterName=passthrough_3, value=code_block_21)

code_block_43 = CodeBlock(Go=toNumber) { Go; }

# group: FINAL Popup Loose
code_block_44 = CodeBlock { true; false; }
code_block_45 = CodeBlock(word=code_block_22, sum=code_block_43, winsum=sum, loose=code_block_44.out0, continues=code_block_44.out1) { word; sum == 6 && winsum !=10 ? loose : continues; }
python_script_9 = Python(IN[0]=code_block_45.word, IN[1]=code_block_45.out1)
# ---------- python_script_9.python (68 lines) ----------
import clr
clr.AddReference("System.Windows.Forms")
clr.AddReference("System.Drawing")
import System
from System.Windows.Forms import *
from System.Drawing import *
from System.Net import *
from System.IO import MemoryStream

word = IN[0]
RunMe = IN[1]

class CreateWindow(Form):
	def __init__(self):
			self.Name = "Create Window"
			self.Text = "Dynword 2023!©"
			self.Size = Size(360, 250)
			self.CenterToScreen()
			        
			label = Label(Text = "Sorry you loose!\nThe word was:")
			label.Parent = self
			label.Location = Point(10, 20)
			label.AutoSize = False
			label.Height = 50
			label.Width = 340
			label.ForeColor = Color.DarkSlateGray
			label.Font = Font(label.Font.Name, 16) 
			label.TextAlign = ContentAlignment.MiddleCenter
						
			picBox = PictureBox()
			picBox.SizeMode = PictureBoxSizeMode.AutoSize
			picBox.Location = System.Drawing.Point(40, 60)

			label = Label(Text =  word + "  ッ")
			label.Parent = self
			label.Location = Point(10, 80)
			label.AutoSize = False
			label.Height = 50
			label.Width = 340
			label.ForeColor = Color.Red
			label.Font = Font(label.Font.Name, 18) 
			label.TextAlign = ContentAlignment.MiddleCenter
								
			button = Button()
			button.Parent = self
			button.Text = " self"
			button.Text = "Close window, click run + 'New Game' on the next pop up"
			button.Font = Font(button.Font.Name, 10)
			button.Location = Point(45, 150)
			button.Width = 255
			button.Height = 50
			button.Click += self.ButtonClicked
			button.BackColor = Color.DarkSlateGray
			button.ForeColor = Color.White     

			# Make the form always on top
			self.TopMost = True

	def ButtonClicked(self, sender, args):
		if sender.Click:
			self.value = "RESET"
			self.Close()

# Call the form
if RunMe:
	form = CreateWindow()
	Application.Run(form)
	OUT = form.value
# ----------------------------------------

# group: reset project name, number and status
code_block_46 = CodeBlock(input=code_block_29) { input == "RESET"? ["Project Name", "Project Number", "Project Status" ]: ""; " "; }
setParameterByName_6 = Element.SetParameterByName(element=code_block_28, parameterName=code_block_46.out0, value=code_block_46.out1, lacing=Longest)

# group: Filled region, lines + text notes from Revit
code_block_47 = CodeBlock { ["Text Notes" , "Lines" ]; }
code_block_48 = CodeBlock(input=code_block_29, itemnames=code_block_47) { input == "RESET"? itemnames : ""; }
byName_2 = Category.ByName(name=code_block_48)
all_elements_of_category_2 = ElementsOfCategory(Category=byName_2)

# group: Get filled regions
code_block_49 = CodeBlock { "FilledRegion"; }
code_block_50 = CodeBlock(input=code_block_29, itemnames=code_block_49) { input == "RESET"? itemnames : ""; }
code_block_51 = CodeBlock(ElementName=code_block_50)  # same code as code_block_8
all_elements_of_type_2 = ElementsOfType(element_type=code_block_51)

# group: Delete filled region + text notes- reset game
code_block_52 = CodeBlock(stuff=all_elements_of_category_2, FR=all_elements_of_type_2) { [stuff , FR]; }
delete = Element.Delete(element=code_block_52)

code_block_53 = CodeBlock { true; }
